% Simulink data dictionary ammclib_types.sldd

SWLIBS_2Syst_F16 = Simulink.Bus(DataScope="Imported", HeaderFile="SWLIBS_Typedefs.h")
  f16Arg1: tFrac16
  f16Arg2: tFrac16

SWLIBS_2Syst_F32 = Simulink.Bus(DataScope="Imported", HeaderFile="SWLIBS_Typedefs.h")
  f32Arg1: tFrac32
  f32Arg2: tFrac32

SWLIBS_2Syst_FLT = Simulink.Bus(DataScope="Imported", HeaderFile="SWLIBS_Typedefs.h")
  fltArg1: tFloat
  fltArg2: tFloat

SWLIBS_2Syst_U16 = Simulink.Bus(DataScope="Imported", HeaderFile="SWLIBS_Typedefs.h")
  u16Arg1: tU16
  u16Arg2: tU16

SWLIBS_2Syst_U32 = Simulink.Bus(DataScope="Imported", HeaderFile="SWLIBS_Typedefs.h")
  u32Arg1: tU32
  u32Arg2: tU32

SWLIBS_3Syst_F16 = Simulink.Bus(DataScope="Imported", HeaderFile="SWLIBS_Typedefs.h")
  f16Arg1: tFrac16
  f16Arg2: tFrac16
  f16Arg3: tFrac16

SWLIBS_3Syst_F32 = Simulink.Bus(DataScope="Imported", HeaderFile="SWLIBS_Typedefs.h")
  f32Arg1: tFrac32
  f32Arg2: tFrac32
  f32Arg3: tFrac32

SWLIBS_3Syst_FLT = Simulink.Bus(DataScope="Imported", HeaderFile="SWLIBS_Typedefs.h")
  fltArg1: tFloat
  fltArg2: tFloat
  fltArg3: tFloat

SWLIBS_3Syst_U16 = Simulink.Bus(DataScope="Imported", HeaderFile="SWLIBS_Typedefs.h")
  u16Arg1: tU16
  u16Arg2: tU16
  u16Arg3: tU16

SWLIBS_6Syst_F16 = Simulink.Bus(DataScope="Imported", HeaderFile="SWLIBS_Typedefs.h")
  f16Arg1: tFrac16
  f16Arg2: tFrac16
  f16Arg3: tFrac16
  f16Arg4: tFrac16
  f16Arg5: tFrac16
  f16Arg6: tFrac16

SWLIBS_6Syst_F32 = Simulink.Bus(DataScope="Imported", HeaderFile="SWLIBS_Typedefs.h")
  f32Arg1: tFrac32
  f32Arg2: tFrac32
  f32Arg3: tFrac32
  f32Arg4: tFrac32
  f32Arg5: tFrac32
  f32Arg6: tFrac32

SWLIBS_6Syst_FLT = Simulink.Bus(DataScope="Imported", HeaderFile="SWLIBS_Typedefs.h")
  fltArg1: tFloat
  fltArg2: tFloat
  fltArg3: tFloat
  fltArg4: tFloat
  fltArg5: tFloat
  fltArg6: tFloat

tDouble = Simulink.AliasType(BaseType="double", DataScope="Imported", HeaderFile="SWLIBS_Typedefs.h")
tFloat = Simulink.AliasType(BaseType="single", DataScope="Imported", HeaderFile="SWLIBS_Typedefs.h")
tFrac16 = Simulink.AliasType(BaseType="tS16", DataScope="Imported", HeaderFile="SWLIBS_Typedefs.h")
tFrac32 = Simulink.AliasType(BaseType="tS32", DataScope="Imported", HeaderFile="SWLIBS_Typedefs.h")
tS16 = Simulink.AliasType(BaseType="int16", DataScope="Imported", HeaderFile="SWLIBS_Typedefs.h")
tS32 = Simulink.AliasType(BaseType="int32", DataScope="Imported", HeaderFile="SWLIBS_Typedefs.h")
tS64 = Simulink.AliasType(BaseType="int64", DataScope="Imported", HeaderFile="SWLIBS_Typedefs.h")
tS8 = Simulink.AliasType(BaseType="int8", DataScope="Imported", HeaderFile="SWLIBS_Typedefs.h")
tU16 = Simulink.AliasType(BaseType="uint16", DataScope="Imported", HeaderFile="SWLIBS_Typedefs.h")
tU32 = Simulink.AliasType(BaseType="uint32", DataScope="Imported", HeaderFile="SWLIBS_Typedefs.h")
tU64 = Simulink.AliasType(BaseType="uint64", DataScope="Imported", HeaderFile="SWLIBS_Typedefs.h")
tU8 = Simulink.AliasType(BaseType="uint8", DataScope="Imported", HeaderFile="SWLIBS_Typedefs.h")

tBool = enum(DataScope="Imported", HeaderFile="SWLIBS_Typedefs.h", DefaultValue="FALSE")
  FALSE = 0
  TRUE = 1

ADFLIB_DECOMP_T_FLT = enum(DataScope="Imported", HeaderFile="ADFLIB_Solve.h", DefaultValue="CHOLESKY")
  CHOLESKY = 0

AMCLIB_BEMF_OBSRV_DQ_T_F16 = Simulink.Bus(DataScope="Imported", HeaderFile="AMCLIB_BemfObsrvDQ.h")
  pEObsrv: Bus: SWLIBS_2Syst_F16
  pIObsrv: Bus: SWLIBS_2Syst_F32
  pParamD: Bus: GFLIB_CONTROLLER_PIAW_R_T_F16
  pParamQ: Bus: GFLIB_CONTROLLER_PIAW_R_T_F16
  pIObsrvIn_1L: Bus: SWLIBS_2Syst_F32
  pIObsrvIn_1H: Bus: SWLIBS_2Syst_F16
  f16IGain: tFrac16
  f16UGain: tFrac16
  f16WIGain: tFrac16
  f16EGain: tFrac16
  s16Shift: tS16

AMCLIB_BEMF_OBSRV_DQ_T_F32 = Simulink.Bus(DataScope="Imported", HeaderFile="AMCLIB_BemfObsrvDQ.h")
  pEObsrv: Bus: SWLIBS_2Syst_F32
  pIObsrv: Bus: SWLIBS_2Syst_F32
  pParamD: Bus: GFLIB_CONTROLLER_PIAW_R_T_F32
  pParamQ: Bus: GFLIB_CONTROLLER_PIAW_R_T_F32
  pIObsrvIn_1L: Bus: SWLIBS_2Syst_F32
  pIObsrvIn_1H: Bus: SWLIBS_2Syst_F16
  f32IGain: tFrac32
  f32UGain: tFrac32
  f32WIGain: tFrac32
  f32EGain: tFrac32
  s16Shift: tS16

AMCLIB_BEMF_OBSRV_DQ_T_FLT = Simulink.Bus(DataScope="Imported", HeaderFile="AMCLIB_BemfObsrvDQ.h")
  pEObsrv: Bus: SWLIBS_2Syst_FLT
  pIObsrv: Bus: SWLIBS_2Syst_FLT
  pParamD: Bus: GFLIB_CONTROLLER_PIAW_R_T_FLT
  pParamQ: Bus: GFLIB_CONTROLLER_PIAW_R_T_FLT
  pIObsrvIn_1: Bus: SWLIBS_2Syst_FLT
  fltIGain: tFloat
  fltUGain: tFloat
  fltWIGain: tFloat
  fltEGain: tFloat

GFLIB_CONTROLLER_PIAW_R_T_F16 = Simulink.Bus(DataScope="Imported", HeaderFile="GFLIB_ControllerPIrAW.h")
  f16CC1sc: tFrac16
  f16CC2sc: tFrac16
  f32Acc: tFrac32
  f16InErrK1: tFrac16
  f16UpperLimit: tFrac16
  f16LowerLimit: tFrac16
  u16NShift: tU16

GFLIB_CONTROLLER_PIAW_R_T_F32 = Simulink.Bus(DataScope="Imported", HeaderFile="GFLIB_ControllerPIrAW.h")
  f32CC1sc: tFrac32
  f32CC2sc: tFrac32
  f32Acc: tFrac32
  f32InErrK1: tFrac32
  f32UpperLimit: tFrac32
  f32LowerLimit: tFrac32
  u16NShift: tU16

GFLIB_CONTROLLER_PIAW_R_T_FLT = Simulink.Bus(DataScope="Imported", HeaderFile="GFLIB_ControllerPIrAW.h")
  fltCC1sc: tFloat
  fltCC2sc: tFloat
  fltAcc: tFloat
  fltInErrK1: tFloat
  fltUpperLimit: tFloat
  fltLowerLimit: tFloat

GFLIB_CONTROLLER_PIAW_P_T_F16 = Simulink.Bus(DataScope="Imported", HeaderFile="GFLIB_ControllerPIpAW.h")
  f16PropGain: tFrac16
  f16IntegGain: tFrac16
  s16PropGainShift: tS16
  s16IntegGainShift: tS16
  f16LowerLimit: tFrac16
  f16UpperLimit: tFrac16
  f32IntegPartK_1: tFrac32
  f16InK_1: tFrac16
  u16LimitFlag: tU16

GFLIB_CONTROLLER_PIAW_P_T_F32 = Simulink.Bus(DataScope="Imported", HeaderFile="GFLIB_ControllerPIpAW.h")
  f32PropGain: tFrac32
  f32IntegGain: tFrac32
  s16PropGainShift: tS16
  s16IntegGainShift: tS16
  f32LowerLimit: tFrac32
  f32UpperLimit: tFrac32
  f32IntegPartK_1: tFrac32
  f32InK_1: tFrac32
  u16LimitFlag: tU16

GFLIB_CONTROLLER_PIAW_P_T_FLT = Simulink.Bus(DataScope="Imported", HeaderFile="GFLIB_ControllerPIpAW.h")
  fltPropGain: tFloat
  fltIntegGain: tFloat
  fltLowerLimit: tFloat
  fltUpperLimit: tFloat
  fltIntegPartK_1: tFloat
  fltInK_1: tFloat
  u16LimitFlag: tU16

AMCLIB_ESTIMBJ_INIT_T_FLT = Simulink.Bus(DataScope="Imported", HeaderFile="AMCLIB_EstimBJ.h")
  u32SamplingFreq: tU32
  fltIN: tFloat
  fltWN: tFloat
  fltPP: tFloat
  fltLd: tFloat
  fltLq: tFloat
  fltRs: tFloat
  fltDtVDrop: tFloat
  fltAlignTime: tFloat
  fltIReqOl: tFloat
  fltWStepOl: tFloat
  fltDCWReq1: tFloat
  fltDCWReq2: tFloat
  fltDcPiPropGain: tFloat
  fltDcPiIntegGain: tFloat
  fltAcPiPropGain: tFloat
  fltAcPiIntegGain: tFloat

AMCLIB_ESTIMBJ_INNERST_SIM_T_FLT = Simulink.Bus(DataScope="Imported", HeaderFile="AMCLIB_EstimBJ.h")
  pState: Enum: AMCLIB_ESTIMBJ_STATE_T
  bTwoPointMeas: Enum: tBool
  u32AlignTimer: tU32
  u32TimerPreset: tU32
  fltIReq: tFloat
  fltDCWReq1: tFloat
  fltDCWReq2: tFloat
  fltACWReq: tFloat
  fltWMax: tFloat
  fltPP: tFloat
  fltWOl: tFloat
  fltThOl: tFloat
  pOLRamp: Bus: GFLIB_RAMP_T_FLT
  pOLInteg: Bus: GFLIB_INTEGRATOR_TR_T_F32
  pIqMAFilter: Bus: GDFLIB_FILTER_MA_T_FLT
  pThRealTransform: Bus: SWLIBS_2Syst_FLT
  pIDQRealFbck: Bus: SWLIBS_2Syst_FLT
  fltWDcReq: tFloat
  fltWAcMaxReq: tFloat
  fltIqDcReq: tFloat
  fltIqAcReq: tFloat
  fltIqAcMaxReq: tFloat
  pWDcReqMAFilter: Bus: GDFLIB_FILTER_MA_T_FLT
  pWAcMaxReqMAFilter: Bus: GDFLIB_FILTER_MA_T_FLT
  pWDcPI: Bus: GFLIB_CONTROLLER_PIAW_P_T_FLT
  pWAcMaxPI: Bus: GFLIB_CONTROLLER_PIAW_P_T_FLT
  fltWAcMaxErr: tFloat
  fltWDcErr2: tFloat
  f32Theta: tFrac32
  pUDQReq: Bus: SWLIBS_2Syst_FLT
  pCloopDPI: Bus: GFLIB_CONTROLLER_PIAW_R_T_FLT
  pCloopQPI: Bus: GFLIB_CONTROLLER_PIAW_R_T_FLT
  pIDQReqCLoop: Bus: SWLIBS_2Syst_FLT
  pIDQFbckCLoop: Bus: SWLIBS_2Syst_FLT
  fltThEl: tFloat
  pThTransform: Bus: SWLIBS_2Syst_FLT
  fltDcRaw: tFloat
  pWABAcRaw: Bus: SWLIBS_2Syst_FLT
  pPllSinCosEst: Bus: SWLIBS_2Syst_FLT
  fltDcFilt: tFloat
  fltAcFilt: tFloat
  fltWABEstErr: tFloat
  pPllDMAFilter: Bus: GDFLIB_FILTER_MA_T_FLT
  pPllQMAFilter: Bus: GDFLIB_FILTER_MA_T_FLT
  pPllDcMAFilter: Bus: GDFLIB_FILTER_MA_T_FLT
  fltPllPiPropGain: tFloat
  f32ThAcEst: tFrac32
  f32ThAcInc: tFrac32
  pFluxEstim: Bus: AMCLIB_FLUXESTIMAB_T_FLT
  fltLd: tFloat
  fltLq: tFloat
  fltWEl: tFloat
  fltThErr: tFloat
  fltThEstim: tFloat
  fltWEstim: tFloat
  pTrackObsrv: Bus: AMCLIB_TRACK_OBSRV_T_FLT
  fltPsiRaw: tFloat
  fltPsiFilt: tFloat
  fltDtVDrop: tFloat
  pFluxMAFilter: Bus: GDFLIB_FILTER_MA_T_FLT
  u32SSTimeoutCnt: tU32
  u32SSBandCnt: tU32
  u32SSTimeoutTime: tU32
  u32SSTime: tU32
  fltSSBandHalfMax: tFloat
  fltSSBandHalf: tFloat
  fltInFilt: tFloat
  pSSMAFilter: Bus: GDFLIB_FILTER_MA_T_FLT
  u16MeasNum: tU16
  fltMeDcArr: tFloat[2]
  fltWDcArr: tFloat[2]
  fltInertiaArr: tFloat[2]
  fltWDcErr: tFloat
  fltGainFOC: tFloat
  fltInvGainATO: tFloat
  fltPhShiftCorr: tFloat
  fltKt: tFloat
  fltJ: tFloat
  fltA: tFloat
  fltB: tFloat

AMCLIB_ESTIMBJ_INNERST_T_FLT = Simulink.Bus(DataScope="Imported", HeaderFile="AMCLIB_EstimBJ.h")
  pState: Enum: AMCLIB_ESTIMBJ_STATE_T
  bTwoPointMeas: Enum: tBool
  u32AlignTimer: tU32
  u32TimerPreset: tU32
  fltIReq: tFloat
  fltDCWReq1: tFloat
  fltDCWReq2: tFloat
  fltACWReq: tFloat
  fltWMax: tFloat
  fltPP: tFloat
  fltWOl: tFloat
  fltThOl: tFloat
  pOLRamp: Bus: GFLIB_RAMP_T_FLT
  pOLInteg: Bus: GFLIB_INTEGRATOR_TR_T_F32
  pIqMAFilter: Bus: GDFLIB_FILTER_MA_T_FLT
  pThRealTransform: Bus: SWLIBS_2Syst_FLT
  pIDQRealFbck: Bus: SWLIBS_2Syst_FLT
  fltWDcReq: tFloat
  fltWAcMaxReq: tFloat
  fltIqDcReq: tFloat
  fltIqAcReq: tFloat
  fltIqAcMaxReq: tFloat
  pWDcReqMAFilter: Bus: GDFLIB_FILTER_MA_T_FLT
  pWAcMaxReqMAFilter: Bus: GDFLIB_FILTER_MA_T_FLT
  pWDcPI: Bus: GFLIB_CONTROLLER_PIAW_P_T_FLT
  pWAcMaxPI: Bus: GFLIB_CONTROLLER_PIAW_P_T_FLT
  fltWAcMaxErr: tFloat
  fltWDcErr2: tFloat
  f32Theta: tFrac32
  pUDQReq: Bus: SWLIBS_2Syst_FLT
  pCurrentLoop: Bus: AMCLIB_CURRENT_LOOP_T_FLT
  pIDQReqCLoop: Bus: SWLIBS_2Syst_FLT
  pIDQFbckCLoop: Bus: SWLIBS_2Syst_FLT
  fltThEl: tFloat
  pThTransform: Bus: SWLIBS_2Syst_FLT
  fltDcRaw: tFloat
  pWABAcRaw: Bus: SWLIBS_2Syst_FLT
  pPllSinCosEst: Bus: SWLIBS_2Syst_FLT
  fltDcFilt: tFloat
  fltAcFilt: tFloat
  fltWABEstErr: tFloat
  pPllDMAFilter: Bus: GDFLIB_FILTER_MA_T_FLT
  pPllQMAFilter: Bus: GDFLIB_FILTER_MA_T_FLT
  pPllDcMAFilter: Bus: GDFLIB_FILTER_MA_T_FLT
  fltPllPiPropGain: tFloat
  f32ThAcEst: tFrac32
  f32ThAcInc: tFrac32
  pFluxEstim: Bus: AMCLIB_FLUXESTIMAB_T_FLT
  fltLd: tFloat
  fltLq: tFloat
  fltWEl: tFloat
  fltThErr: tFloat
  fltThEstim: tFloat
  fltWEstim: tFloat
  pTrackObsrv: Bus: AMCLIB_TRACK_OBSRV_T_FLT
  fltPsiRaw: tFloat
  fltPsiFilt: tFloat
  fltDtVDrop: tFloat
  pFluxMAFilter: Bus: GDFLIB_FILTER_MA_T_FLT
  u32SSTimeoutCnt: tU32
  u32SSBandCnt: tU32
  u32SSTimeoutTime: tU32
  u32SSTime: tU32
  fltSSBandHalfMax: tFloat
  fltSSBandHalf: tFloat
  fltInFilt: tFloat
  pSSMAFilter: Bus: GDFLIB_FILTER_MA_T_FLT
  u16MeasNum: tU16
  fltMeDcArr: tFloat[2]
  fltWDcArr: tFloat[2]
  fltInertiaArr: tFloat[2]
  fltWDcErr: tFloat
  fltGainFOC: tFloat
  fltInvGainATO: tFloat
  fltPhShiftCorr: tFloat

AMCLIB_ESTIMBJ_T_FLT = Simulink.Bus(DataScope="Imported", HeaderFile="AMCLIB_EstimBJ.h")
  fltKt: tFloat
  fltJ: tFloat
  fltA: tFloat
  fltB: tFloat
  pInnerState: Bus: AMCLIB_ESTIMBJ_INNERST_T_FLT

AMCLIB_FLUXESTIMAB_T_F16 = Simulink.Bus(DataScope="Imported", HeaderFile="AMCLIB_FluxEstimAB.h")
  f16KRs: tFrac16
  f16KLs: tFrac16
  u16NShift: tU16

AMCLIB_FLUXESTIMAB_T_F32 = Simulink.Bus(DataScope="Imported", HeaderFile="AMCLIB_FluxEstimAB.h")
  f32KRs: tFrac32
  f32KLs: tFrac32
  u16NShift: tU16

AMCLIB_FLUXESTIMAB_T_FLT = Simulink.Bus(DataScope="Imported", HeaderFile="AMCLIB_FluxEstimAB.h")
  fltRs: tFloat
  fltLs: tFloat

AMCLIB_TRACK_OBSRV_T_F16 = Simulink.Bus(DataScope="Imported", HeaderFile="AMCLIB_TrackObsrv.h")
  pParamPI: Bus: GFLIB_CONTROLLER_PIAW_R_T_F16
  pParamInteg: Bus: GFLIB_INTEGRATOR_TR_T_F16

AMCLIB_TRACK_OBSRV_T_F32 = Simulink.Bus(DataScope="Imported", HeaderFile="AMCLIB_TrackObsrv.h")
  pParamPI: Bus: GFLIB_CONTROLLER_PIAW_R_T_F32
  pParamInteg: Bus: GFLIB_INTEGRATOR_TR_T_F32

AMCLIB_TRACK_OBSRV_T_FLT = Simulink.Bus(DataScope="Imported", HeaderFile="AMCLIB_TrackObsrv.h")
  pParamPI: Bus: GFLIB_CONTROLLER_PIAW_R_T_FLT
  pParamInteg: Bus: GFLIB_INTEGRATOR_TR_T_FLT

GDFLIB_FILTER_MA_T_F16 = Simulink.Bus(DataScope="Imported", HeaderFile="GDFLIB_FilterMA.h")
  f32Acc: tFrac32
  u16NSamples: tU16

GDFLIB_FILTER_MA_T_F32 = Simulink.Bus(DataScope="Imported", HeaderFile="GDFLIB_FilterMA.h")
  f32Acc: tFrac32
  u16NSamples: tU16

GDFLIB_FILTER_MA_T_FLT = Simulink.Bus(DataScope="Imported", HeaderFile="GDFLIB_FilterMA.h")
  fltAcc: tFloat
  fltLambda: tFloat

GFLIB_ATAN_TAYLOR_COEF_T_F16 = Simulink.Bus(DataScope="Imported", HeaderFile="GFLIB_Atan.h")
  f16A: int16[3]

GFLIB_ATAN_TAYLOR_COEF_T_F32 = Simulink.Bus(DataScope="Imported", HeaderFile="GFLIB_Atan.h")
  f32A: int32[3]

GFLIB_ATAN_T_F16 = Simulink.Bus(DataScope="Imported", HeaderFile="GFLIB_Atan.h")
  GFLIB_ATAN_SECTOR: Bus: GFLIB_ATAN_TAYLOR_COEF_T_F16[8]

GFLIB_ATAN_T_F32 = Simulink.Bus(DataScope="Imported", HeaderFile="GFLIB_Atan.h")
  GFLIB_ATAN_SECTOR: Bus: GFLIB_ATAN_TAYLOR_COEF_T_F32[8]

GFLIB_ATAN_T_FLT = Simulink.Bus(DataScope="Imported", HeaderFile="GFLIB_Atan.h")
  fltA: single[6]

GFLIB_COS_T_F16 = Simulink.Bus(DataScope="Imported", HeaderFile="GFLIB_Cos.h")
  f16A: tFrac16[4]

GFLIB_COS_T_F32 = Simulink.Bus(DataScope="Imported", HeaderFile="GFLIB_Cos.h")
  f32A: tFrac32[5]

GFLIB_COS_T_FLT = Simulink.Bus(DataScope="Imported", HeaderFile="GFLIB_Cos.h")
  fltA: tFloat[3]

GFLIB_INTEGRATOR_TR_T_F16 = Simulink.Bus(DataScope="Imported", HeaderFile="GFLIB_IntegratorTR.h")
  f32State: tFrac32
  f16InK1: tFrac16
  f16C1: tFrac16
  u16NShift: tU16

GFLIB_INTEGRATOR_TR_T_F32 = Simulink.Bus(DataScope="Imported", HeaderFile="GFLIB_IntegratorTR.h")
  f32State: tFrac32
  f32InK1: tFrac32
  f32C1: tFrac32
  u16NShift: tU16

GFLIB_INTEGRATOR_TR_T_FLT = Simulink.Bus(DataScope="Imported", HeaderFile="GFLIB_IntegratorTR.h")
  fltState: tFloat
  fltInK1: tFloat
  fltC1: tFloat

GFLIB_RAMP_T_F16 = Simulink.Bus(DataScope="Imported", HeaderFile="GFLIB_Ramp.h")
  f16State: tFrac16
  f16RampUp: tFrac16
  f16RampDown: tFrac16

GFLIB_RAMP_T_F32 = Simulink.Bus(DataScope="Imported", HeaderFile="GFLIB_Ramp.h")
  f32State: tFrac32
  f32RampUp: tFrac32
  f32RampDown: tFrac32

GFLIB_RAMP_T_FLT = Simulink.Bus(DataScope="Imported", HeaderFile="GFLIB_Ramp.h")
  fltState: tFloat
  fltRampUp: tFloat
  fltRampDown: tFloat

GFLIB_SINCOS_T_F16 = Simulink.Bus(DataScope="Imported", HeaderFile="GFLIB_SinCos.h")
  f16A: tFrac16[4]

GFLIB_SINCOS_T_F32 = Simulink.Bus(DataScope="Imported", HeaderFile="GFLIB_SinCos.h")
  f32A: tFrac32[5]

GFLIB_SINCOS_T_FLT = Simulink.Bus(DataScope="Imported", HeaderFile="GFLIB_SinCos.h")
  fltA: tFloat[3]

GFLIB_SIN_T_F16 = Simulink.Bus(DataScope="Imported", HeaderFile="GFLIB_Sin.h")
  f16A: tFrac16[4]

GFLIB_SIN_T_F32 = Simulink.Bus(DataScope="Imported", HeaderFile="GFLIB_Sin.h")
  f32A: tFrac32[5]

GFLIB_SIN_T_FLT = Simulink.Bus(DataScope="Imported", HeaderFile="GFLIB_Sin.h")
  fltA: tFloat[3]

AMCLIB_ESTIMBJINIT_RET_T = enum(DataScope="Imported", HeaderFile="AMCLIB_EstimBJ.h", DefaultValue="ESTIMBJ_RET_INIT_OK")
  ESTIMBJ_RET_INIT_OK = 0
  ESTIMBJ_RET_INIT_ERROR = 1

AMCLIB_ESTIMBJ_RET_T = enum(DataScope="Imported", HeaderFile="AMCLIB_EstimBJ.h", DefaultValue="ESTIMBJ_RET_IN_PROGRESS")
  ESTIMBJ_RET_IN_PROGRESS = 0
  ESTIMBJ_RET_DONE = 1
  ESTIMBJ_RET_ERROR = 2

AMCLIB_ESTIMBJ_STATE_T = enum(DataScope="Imported", HeaderFile="AMCLIB_EstimBJ.h", DefaultValue="ESTIMBJ_STATE_UNINITIALIZED")
  ESTIMBJ_STATE_UNINITIALIZED = 0
  ESTIMBJ_STATE_ROTOR_ALIGN = 1
  ESTIMBJ_STATE_OL_STARTUP = 2
  ESTIMBJ_STATE_FLUX_ESTIM = 3
  ESTIMBJ_STATE_PARAM_EST_MEAS = 4
  ESTIMBJ_STATE_DONE = 5
  ESTIMBJ_STATE_ERROR = 6

AMCLIB_ESTIMRL_INIT_T_FLT = Simulink.Bus(DataScope="Imported", HeaderFile="AMCLIB_EstimRL.h")
  fltIDcMax: tFloat
  u16LdqNumMeas: tU16
  fltIDcLd: tFloat
  fltIDcLq: tFloat
  fltIDcNegMax: tFloat

AMCLIB_ESTIMRL_INNERST_T_FLT = Simulink.Bus(DataScope="Imported", HeaderFile="AMCLIB_EstimRL.h")
  pState: Enum: AMCLIB_ESTIMRL_STATE_T
  f32FAc: tFrac32
  fltIDcMax: tFloat
  fltIDcNegMax: tFloat
  fltIDcMaxInv: tFloat
  fltIAcReq: tFloat
  fltIAcReqInv: tFloat
  fltIDcDReq: tFloat
  fltIDcDReqk_1: tFloat
  fltIDcQReq: tFloat
  fltIDcQReqk_1: tFloat
  fltIDcReqStep: tFloat
  fltIAlBeEstErr: tFloat
  pIAlBeAc: Bus: SWLIBS_2Syst_FLT
  pSinCosEst: Bus: SWLIBS_2Syst_FLT
  pIDQAcRaw: Bus: SWLIBS_2Syst_FLT
  pIDQAcFilt: Bus: SWLIBS_2Syst_FLT
  pDAxisFilter: Bus: GDFLIB_FILTER_MA_T_FLT
  pQAxisFilter: Bus: GDFLIB_FILTER_MA_T_FLT
  pDcFilter: Bus: GDFLIB_FILTER_MA_T_FLT
  pStdFilter: Bus: GDFLIB_FILTER_MA_T_FLT
  fltPLLPropGain: tFloat
  f32ThAc: tFrac32
  f32ThEst: tFrac32
  fltIDcD: tFloat
  fltIDcQ: tFloat
  fltIDcDAvg: tFloat
  fltIDcDAvgk_1: tFloat
  fltPhComp: tFloat
  s32ConvDetState: tS32
  s32ConvDetStateLimL: tS32
  s32ConvDetStateLimH: tS32
  u32ConvDetToutCnt: tU32
  u32ConvDetToutReload: tU32
  u32AvgCnt: tU32
  u32AvgN: tU32
  fltAvgNInv: tFloat
  fltAvgNInvMaxDelta: tFloat
  u32AvgCntMax: tU32
  fltPhAvg: tFloat
  fltIAcAvg: tFloat
  fltUAcAvg: tFloat
  fltAvgMul: tFloat
  fltAvgMin: tFloat
  u16LdqNumMeas: tU16
  u32TblCounter: tU32
  u8RotorFixed: tU8
  fltIDcRampCoef: tFloat
  fltIDcRampCoefMax: tFloat
  fltIDcDRampAcc: tFloat
  fltIDcQRampAcc: tFloat
  fltUDcDAcc: tFloat
  fltUDcDAccAvg: tFloat
  fltUDcDAccAvgk_1: tFloat
  fltUDcQAcc: tFloat
  fltUAcAcc: tFloat
  fltUDcKi: tFloat
  fltUAcKi: tFloat
  fltUDcKiNominal: tFloat
  fltUAcKiNominal: tFloat
  u16RampSteady: tU16
  u16DcbLimitFlag: tU16
  u16DcbLimitFlagk_1: tU16
  u16DcbLimitCnt: tU16
  fltPhaseShift: tFloat
  fltUdcHalf: tFloat
  fltFsInv: tFloat
  fltImpConst: tFloat
  fltLdk_1: tFloat
  fltLqk_1: tFloat
  fltIDcLd: tFloat
  fltIDcLq: tFloat
  fltUdtAcc: tFloat
  fltRAcc: tFloat
  u16LdqNumMeasR: tU16
  fltUDcBusMax: tFloat

AMCLIB_ESTIMRL_T_FLT = Simulink.Bus(DataScope="Imported", HeaderFile="AMCLIB_EstimRL.h")
  fltLd: tFloat
  fltLq: tFloat
  fltR: tFloat
  fltUdt: tFloat
  pInnerState: Bus: AMCLIB_ESTIMRL_INNERST_T_FLT

GMCLIB_ELIMDCBUSRIP_T_F16 = Simulink.Bus(DataScope="Imported", HeaderFile="GMCLIB_ElimDcBusRip.h")
  f16ArgDcBusMsr: tFrac16
  f16ModIndex: tFrac16

GMCLIB_ELIMDCBUSRIP_T_F32 = Simulink.Bus(DataScope="Imported", HeaderFile="GMCLIB_ElimDcBusRip.h")
  f32ArgDcBusMsr: tFrac32
  f32ModIndex: tFrac32

GMCLIB_ELIMDCBUSRIP_T_FLT = Simulink.Bus(DataScope="Imported", HeaderFile="GMCLIB_ElimDcBusRip.h")
  fltArgDcBusMsr: tFloat
  fltModIndex: tFloat

AMCLIB_ESTIMRLINIT_RET_T = enum(DataScope="Imported", HeaderFile="AMCLIB_EstimRL.h", DefaultValue="RET_INIT_OK")
  RET_INIT_OK = 0
  RET_INIT_ERROR = 1

AMCLIB_ESTIMRL_RET_T = enum(DataScope="Imported", HeaderFile="AMCLIB_EstimRL.h", DefaultValue="RET_IN_PROGRESS")
  RET_IN_PROGRESS = 0
  RET_DONE = 1
  RET_ERROR = 2

AMCLIB_ESTIMRL_STATE_T = enum(DataScope="Imported", HeaderFile="AMCLIB_EstimRL.h", DefaultValue="STATE_UNINITIALIZED")
  STATE_UNINITIALIZED = 0
  STATE_MEAS_LD = 1
  STATE_MEAS_LQ = 2
  STATE_LD_TO_LQ = 3
  STATE_POSTPROCESS_LD = 4
  STATE_POSTPROCESS_LQ = 5
  STATE_UNWIND = 6
  STATE_DONE = 7
  STATE_ERROR = 8

AMCLIB_SPEED_LOOP_DEBUG_T_F16 = Simulink.Bus(DataScope="Imported", HeaderFile="AMCLIB_SpeedLoop.h")
  pFilterW: Bus: GDFLIB_FILTER_MA_T_F16
  pPIpAWQ: Bus: GFLIB_CONTROLLER_PIAW_P_T_F16
  pRamp: Bus: GFLIB_RAMP_T_F32
  f16WReqFilt: tFrac16
  f16WErr: tFrac16
  f16WFbckFilt: tFrac16

AMCLIB_SPEED_LOOP_DEBUG_T_F32 = Simulink.Bus(DataScope="Imported", HeaderFile="AMCLIB_SpeedLoop.h")
  pFilterW: Bus: GDFLIB_FILTER_MA_T_F32
  pPIpAWQ: Bus: GFLIB_CONTROLLER_PIAW_P_T_F32
  pRamp: Bus: GFLIB_RAMP_T_F32
  f32WReqFilt: tFrac32
  f32WErr: tFrac32
  f32WFbckFilt: tFrac32

AMCLIB_SPEED_LOOP_DEBUG_T_FLT = Simulink.Bus(DataScope="Imported", HeaderFile="AMCLIB_SpeedLoop.h")
  pFilterW: Bus: GDFLIB_FILTER_MA_T_FLT
  pPIpAWQ: Bus: GFLIB_CONTROLLER_PIAW_P_T_FLT
  pRamp: Bus: GFLIB_RAMP_T_FLT
  fltWReqFilt: tFloat
  fltWErr: tFloat
  fltWFbckFilt: tFloat

AMCLIB_SPEED_LOOP_T_F16 = Simulink.Bus(DataScope="Imported", HeaderFile="AMCLIB_SpeedLoop.h")
  pFilterW: Bus: GDFLIB_FILTER_MA_T_F16
  pPIpAWQ: Bus: GFLIB_CONTROLLER_PIAW_P_T_F16
  pRamp: Bus: GFLIB_RAMP_T_F32

AMCLIB_SPEED_LOOP_T_F32 = Simulink.Bus(DataScope="Imported", HeaderFile="AMCLIB_SpeedLoop.h")
  pFilterW: Bus: GDFLIB_FILTER_MA_T_F32
  pPIpAWQ: Bus: GFLIB_CONTROLLER_PIAW_P_T_F32
  pRamp: Bus: GFLIB_RAMP_T_F32

AMCLIB_SPEED_LOOP_T_FLT = Simulink.Bus(DataScope="Imported", HeaderFile="AMCLIB_SpeedLoop.h")
  pFilterW: Bus: GDFLIB_FILTER_MA_T_FLT
  pPIpAWQ: Bus: GFLIB_CONTROLLER_PIAW_P_T_FLT
  pRamp: Bus: GFLIB_RAMP_T_FLT

AMCLIB_WINDMILLING_T_F16 = Simulink.Bus(DataScope="Imported", HeaderFile="AMCLIB_Windmilling.h")
  f16ADCComp: tFrac16
  pParamATO: Bus: AMCLIB_TRACK_OBSRV_T_F16
  pDetMA: Bus: GDFLIB_FILTER_MA_T_F16
  u8DetNoiseCnt: tU8
  u8DetSpin: tU8
  u16DetHystCnt: tU16
  u16DetStopCnt: tU16

AMCLIB_WINDMILLING_T_F32 = Simulink.Bus(DataScope="Imported", HeaderFile="AMCLIB_Windmilling.h")
  f32ADCComp: tFrac32
  pParamATO: Bus: AMCLIB_TRACK_OBSRV_T_F32
  pDetMA: Bus: GDFLIB_FILTER_MA_T_F32
  u8DetNoiseCnt: tU8
  u8DetSpin: tU8
  u16DetHystCnt: tU16
  u16DetStopCnt: tU16

AMCLIB_WINDMILLING_T_FLT = Simulink.Bus(DataScope="Imported", HeaderFile="AMCLIB_Windmilling.h")
  fltADCComp: tFloat
  pParamATO: Bus: AMCLIB_TRACK_OBSRV_T_FLT
  pDetMA: Bus: GDFLIB_FILTER_MA_T_FLT
  u8DetNoiseCnt: tU8
  u8DetSpin: tU8
  u16DetHystCnt: tU16
  u16DetStopCnt: tU16

AMCLIB_WINDMILLING_RET_T = enum(DataScope="Imported", HeaderFile="AMCLIB_Windmilling.h", DefaultValue="UNDECIDED")
  UNDECIDED = 0
  SPINNING = 1
  STOPPED = 2

GDFLIB_FILTER_IIR1_COEFF_T_F16 = Simulink.Bus(DataScope="Imported", HeaderFile="GDFLIB_FilterIIR1.h")
  f16B0: tFrac16
  f16B1: tFrac16
  f16A1: tFrac16

GDFLIB_FILTER_IIR1_COEFF_T_F32 = Simulink.Bus(DataScope="Imported", HeaderFile="GDFLIB_FilterIIR1.h")
  f32B0: tFrac32
  f32B1: tFrac32
  f32A1: tFrac32

GDFLIB_FILTER_IIR1_COEFF_T_FLT = Simulink.Bus(DataScope="Imported", HeaderFile="GDFLIB_FilterIIR1.h")
  fltB0: tFloat
  fltB1: tFloat
  fltA1: tFloat

GDFLIB_FILTER_IIR1_T_F16 = Simulink.Bus(DataScope="Imported", HeaderFile="GDFLIB_FilterIIR1.h")
  trFiltCoeff: Bus: GDFLIB_FILTER_IIR1_COEFF_T_F16
  f16FiltBufferX: tFrac16
  f32FiltBufferY: tFrac32

GDFLIB_FILTER_IIR1_T_F32 = Simulink.Bus(DataScope="Imported", HeaderFile="GDFLIB_FilterIIR1.h")
  trFiltCoeff: Bus: GDFLIB_FILTER_IIR1_COEFF_T_F32
  f32FiltBufferX: tFrac32
  f32FiltBufferY: tFrac32

GDFLIB_FILTER_IIR1_T_FLT = Simulink.Bus(DataScope="Imported", HeaderFile="GDFLIB_FilterIIR1.h")
  trFiltCoeff: Bus: GDFLIB_FILTER_IIR1_COEFF_T_FLT
  fltFiltBufferX: tFloat
  fltFiltBufferY: tFloat

GDFLIB_FILTER_IIR2_COEFF_T_F16 = Simulink.Bus(DataScope="Imported", HeaderFile="GDFLIB_FilterIIR2.h")
  f16B0: tFrac16
  f16B1: tFrac16
  f16B2: tFrac16
  f16A1: tFrac16
  f16A2: tFrac16

GDFLIB_FILTER_IIR2_COEFF_T_F32 = Simulink.Bus(DataScope="Imported", HeaderFile="GDFLIB_FilterIIR2.h")
  f32B0: tFrac32
  f32B1: tFrac32
  f32B2: tFrac32
  f32A1: tFrac32
  f32A2: tFrac32

GDFLIB_FILTER_IIR2_COEFF_T_FLT = Simulink.Bus(DataScope="Imported", HeaderFile="GDFLIB_FilterIIR2.h")
  fltB0: tFloat
  fltB1: tFloat
  fltB2: tFloat
  fltA1: tFloat
  fltA2: tFloat

GDFLIB_FILTER_IIR2_T_F16 = Simulink.Bus(DataScope="Imported", HeaderFile="GDFLIB_FilterIIR2.h")
  trFiltCoeff: Bus: GDFLIB_FILTER_IIR2_COEFF_T_F16
  f16FiltBufferX: tFrac16[2]
  f32FiltBufferY: tFrac32[2]

GDFLIB_FILTER_IIR2_T_F32 = Simulink.Bus(DataScope="Imported", HeaderFile="GDFLIB_FilterIIR2.h")
  trFiltCoeff: Bus: GDFLIB_FILTER_IIR2_COEFF_T_F32
  f32FiltBufferX: tFrac32[2]
  f32FiltBufferY: tFrac32[2]

GDFLIB_FILTER_IIR2_T_FLT = Simulink.Bus(DataScope="Imported", HeaderFile="GDFLIB_FilterIIR2.h")
  trFiltCoeff: Bus: GDFLIB_FILTER_IIR2_COEFF_T_FLT
  fltFiltBufferX: tFloat[2]
  fltFiltBufferY: tFloat[2]

GFLIB_ACOS_TAYLOR_COEF_T_F16 = Simulink.Bus(DataScope="Imported", HeaderFile="GFLIB_Acos.h")
  f16A: int16[5]

GFLIB_ACOS_TAYLOR_COEF_T_F32 = Simulink.Bus(DataScope="Imported", HeaderFile="GFLIB_Acos.h")
  f32A: int32[5]

GFLIB_ACOS_T_F16 = Simulink.Bus(DataScope="Imported", HeaderFile="GFLIB_Acos.h")
  GFLIB_ACOS_SECTOR: Bus: GFLIB_ACOS_TAYLOR_COEF_T_F16[2]

GFLIB_ACOS_T_F32 = Simulink.Bus(DataScope="Imported", HeaderFile="GFLIB_Acos.h")
  GFLIB_ACOS_SECTOR: Bus: GFLIB_ACOS_TAYLOR_COEF_T_F32[3]

GFLIB_ACOS_T_FLT = Simulink.Bus(DataScope="Imported", HeaderFile="GFLIB_Acos.h")
  fltA: single[5]

GFLIB_ASIN_TAYLOR_COEF_T_F16 = Simulink.Bus(DataScope="Imported", HeaderFile="GFLIB_Asin.h")
  f16A: int16[5]

GFLIB_ASIN_TAYLOR_COEF_T_F32 = Simulink.Bus(DataScope="Imported", HeaderFile="GFLIB_Asin.h")
  f32A: int32[5]

GFLIB_ASIN_T_F16 = Simulink.Bus(DataScope="Imported", HeaderFile="GFLIB_Asin.h")
  GFLIB_ASIN_SECTOR: Bus: GFLIB_ASIN_TAYLOR_COEF_T_F16[2]

GFLIB_ASIN_T_F32 = Simulink.Bus(DataScope="Imported", HeaderFile="GFLIB_Asin.h")
  GFLIB_ASIN_SECTOR: Bus: GFLIB_ASIN_TAYLOR_COEF_T_F32[3]

GFLIB_ASIN_T_FLT = Simulink.Bus(DataScope="Imported", HeaderFile="GFLIB_Asin.h")
  fltA: single[7]

GFLIB_ATANYXSHIFTED_T_F16 = Simulink.Bus(DataScope="Imported", HeaderFile="GFLIB_AtanYXShifted.h")
  f16Ky: tFrac16
  f16Kx: tFrac16
  s16Ny: tS16
  s16Nx: tS16
  f16ThetaAdj: tFrac16

GFLIB_ATANYXSHIFTED_T_F32 = Simulink.Bus(DataScope="Imported", HeaderFile="GFLIB_AtanYXShifted.h")
  f32Ky: tFrac32
  f32Kx: tFrac32
  s32Ny: tS32
  s32Nx: tS32
  f32ThetaAdj: tFrac32

GFLIB_ATANYXSHIFTED_T_FLT = Simulink.Bus(DataScope="Imported", HeaderFile="GFLIB_AtanYXShifted.h")
  fltKy: tFloat
  fltKx: tFloat
  fltThetaAdj: tFloat

GFLIB_CONTROLLER_PID_P_AW_T_F16 = Simulink.Bus(DataScope="Imported", HeaderFile="GFLIB_ControllerPIDpAW.h")
  f16PropGain: tFrac16
  f16IntegGain: tFrac16
  f16DerivGain: tFrac16
  f16FiltCoef: tFrac16
  s16PropGainShift: tS16
  s16IntegGainShift: tS16
  s16DerivGainShift: tS16
  f16LowerLimit: tFrac16
  f16UpperLimit: tFrac16
  f32IntegPartK_1: tFrac32
  f16DerivPartK_1: tFrac16
  f16InK_1: tFrac16
  u16LimitFlag: tU16

GFLIB_CONTROLLER_PID_P_AW_T_F32 = Simulink.Bus(DataScope="Imported", HeaderFile="GFLIB_ControllerPIDpAW.h")
  f32PropGain: tFrac32
  f32IntegGain: tFrac32
  f32DerivGain: tFrac32
  f32FiltCoef: tFrac32
  s16PropGainShift: tS16
  s16IntegGainShift: tS16
  s16DerivGainShift: tS16
  f32LowerLimit: tFrac32
  f32UpperLimit: tFrac32
  f32IntegPartK_1: tFrac32
  f32DerivPartK_1: tFrac32
  f32InK_1: tFrac32
  u16LimitFlag: tU16

GFLIB_CONTROLLER_PID_P_AW_T_FLT = Simulink.Bus(DataScope="Imported", HeaderFile="GFLIB_ControllerPIDpAW.h")
  fltPropGain: tFloat
  fltIntegGain: tFloat
  fltDerivGain: tFloat
  fltFiltCoef: tFloat
  fltLowerLimit: tFloat
  fltUpperLimit: tFloat
  fltIntegPartK_1: tFloat
  fltDerivPartK_1: tFloat
  fltInK_1: tFloat
  u16LimitFlag: tU16

GFLIB_CONTROLLER_PI_P_T_F16 = Simulink.Bus(DataScope="Imported", HeaderFile="GFLIB_ControllerPIp.h")
  f16PropGain: tFrac16
  f16IntegGain: tFrac16
  s16PropGainShift: tS16
  s16IntegGainShift: tS16
  f32IntegPartK_1: tFrac32
  f16InK_1: tFrac16

GFLIB_CONTROLLER_PI_P_T_F32 = Simulink.Bus(DataScope="Imported", HeaderFile="GFLIB_ControllerPIp.h")
  f32PropGain: tFrac32
  f32IntegGain: tFrac32
  s16PropGainShift: tS16
  s16IntegGainShift: tS16
  f32IntegPartK_1: tFrac32
  f32InK_1: tFrac32

GFLIB_CONTROLLER_PI_P_T_FLT = Simulink.Bus(DataScope="Imported", HeaderFile="GFLIB_ControllerPIp.h")
  fltPropGain: tFloat
  fltIntegGain: tFloat
  fltIntegPartK_1: tFloat
  fltInK_1: tFloat

GFLIB_CONTROLLER_PI_R_T_F16 = Simulink.Bus(DataScope="Imported", HeaderFile="GFLIB_ControllerPIr.h")
  f16CC1sc: tFrac16
  f16CC2sc: tFrac16
  f32Acc: tFrac32
  f16InErrK1: tFrac16
  u16NShift: tU16

GFLIB_CONTROLLER_PI_R_T_F32 = Simulink.Bus(DataScope="Imported", HeaderFile="GFLIB_ControllerPIr.h")
  f32CC1sc: tFrac32
  f32CC2sc: tFrac32
  f32Acc: tFrac32
  f32InErrK1: tFrac32
  u16NShift: tU16

GFLIB_CONTROLLER_PI_R_T_FLT = Simulink.Bus(DataScope="Imported", HeaderFile="GFLIB_ControllerPIr.h")
  fltCC1sc: tFloat
  fltCC2sc: tFloat
  fltAcc: tFloat
  fltInErrK1: tFloat

GFLIB_HYST_T_F16 = Simulink.Bus(DataScope="Imported", HeaderFile="GFLIB_Hyst.h")
  f16HystOn: tFrac16
  f16HystOff: tFrac16
  f16OutValOn: tFrac16
  f16OutValOff: tFrac16
  f16OutState: tFrac16

GFLIB_HYST_T_F32 = Simulink.Bus(DataScope="Imported", HeaderFile="GFLIB_Hyst.h")
  f32HystOn: tFrac32
  f32HystOff: tFrac32
  f32OutValOn: tFrac32
  f32OutValOff: tFrac32
  f32OutState: tFrac32

GFLIB_HYST_T_FLT = Simulink.Bus(DataScope="Imported", HeaderFile="GFLIB_Hyst.h")
  fltHystOn: tFloat
  fltHystOff: tFloat
  fltOutValOn: tFloat
  fltOutValOff: tFloat
  fltOutState: tFloat

GFLIB_LIMIT_T_F16 = Simulink.Bus(DataScope="Imported", HeaderFile="GFLIB_Limit.h")
  f16LowerLimit: tFrac16
  f16UpperLimit: tFrac16

GFLIB_LIMIT_T_F32 = Simulink.Bus(DataScope="Imported", HeaderFile="GFLIB_Limit.h")
  f32LowerLimit: tFrac32
  f32UpperLimit: tFrac32

GFLIB_LIMIT_T_FLT = Simulink.Bus(DataScope="Imported", HeaderFile="GFLIB_Limit.h")
  fltLowerLimit: tFloat
  fltUpperLimit: tFloat

GFLIB_LOG10_T_FLT = Simulink.Bus(DataScope="Imported", HeaderFile="GFLIB_Log10.h")
  fltA: tFloat[5]

GFLIB_LOWERLIMIT_T_F16 = Simulink.Bus(DataScope="Imported", HeaderFile="GFLIB_LowerLimit.h")
  f16LowerLimit: tFrac16

GFLIB_LOWERLIMIT_T_F32 = Simulink.Bus(DataScope="Imported", HeaderFile="GFLIB_LowerLimit.h")
  f32LowerLimit: tFrac32

GFLIB_LOWERLIMIT_T_FLT = Simulink.Bus(DataScope="Imported", HeaderFile="GFLIB_LowerLimit.h")
  fltLowerLimit: tFloat

GFLIB_TAN_TAYLOR_COEF_T_F16 = Simulink.Bus(DataScope="Imported", HeaderFile="GFLIB_Tan.h")
  f16A: int16[4]

GFLIB_TAN_TAYLOR_COEF_T_F32 = Simulink.Bus(DataScope="Imported", HeaderFile="GFLIB_Tan.h")
  f32A: int32[4]

GFLIB_TAN_T_F16 = Simulink.Bus(DataScope="Imported", HeaderFile="GFLIB_Tan.h")
  GFLIB_TAN_SECTOR: Bus: GFLIB_TAN_TAYLOR_COEF_T_F16[8]

GFLIB_TAN_T_F32 = Simulink.Bus(DataScope="Imported", HeaderFile="GFLIB_Tan.h")
  GFLIB_TAN_SECTOR: Bus: GFLIB_TAN_TAYLOR_COEF_T_F32[8]

GFLIB_TAN_T_FLT = Simulink.Bus(DataScope="Imported", HeaderFile="GFLIB_Tan.h")
  fltA: tFloat[4]

GFLIB_UPPERLIMIT_T_F16 = Simulink.Bus(DataScope="Imported", HeaderFile="GFLIB_UpperLimit.h")
  f16UpperLimit: tFrac16

GFLIB_UPPERLIMIT_T_F32 = Simulink.Bus(DataScope="Imported", HeaderFile="GFLIB_UpperLimit.h")
  f32UpperLimit: tFrac32

GFLIB_UPPERLIMIT_T_FLT = Simulink.Bus(DataScope="Imported", HeaderFile="GFLIB_UpperLimit.h")
  fltUpperLimit: tFloat

GFLIB_VLOG10_T_FLT = Simulink.Bus(DataScope="Imported", HeaderFile="GFLIB_VLog10.h")
  fltA: tFloat[5]

GFLIB_VECTORLIMIT_T_F16 = Simulink.Bus(DataScope="Imported", HeaderFile="GFLIB_VectorLimit.h")
  f16Limit: tFrac16

GFLIB_VECTORLIMIT_T_F32 = Simulink.Bus(DataScope="Imported", HeaderFile="GFLIB_VectorLimit.h")
  f32Limit: tFrac32

GFLIB_VECTORLIMIT_T_FLT = Simulink.Bus(DataScope="Imported", HeaderFile="GFLIB_VectorLimit.h")
  fltLimit: tFloat

GMCLIB_CLARK_6PH_T_F16 = Simulink.Bus(DataScope="Imported", HeaderFile="GMCLIB_Clark6Ph.h")
  f16AlphaD: tFrac16
  f16AlphaE: tFrac16
  f16AlphaF: tFrac16
  f16BetaD: tFrac16
  f16BetaE: tFrac16
  f16BetaF: tFrac16

GMCLIB_CLARK_6PH_T_F32 = Simulink.Bus(DataScope="Imported", HeaderFile="GMCLIB_Clark6Ph.h")
  f32AlphaD: tFrac32
  f32AlphaE: tFrac32
  f32AlphaF: tFrac32
  f32BetaD: tFrac32
  f32BetaE: tFrac32
  f32BetaF: tFrac32

GMCLIB_CLARK_6PH_T_FLT = Simulink.Bus(DataScope="Imported", HeaderFile="GMCLIB_Clark6Ph.h")
  fltAlphaD: tFloat
  fltAlphaE: tFloat
  fltAlphaF: tFloat
  fltBetaD: tFloat
  fltBetaE: tFloat
  fltBetaF: tFloat

GMCLIB_CLARKINV_6PH_T_F16 = Simulink.Bus(DataScope="Imported", HeaderFile="GMCLIB_ClarkInv6Ph.h")
  f16AlphaD: tFrac16
  f16AlphaE: tFrac16
  f16AlphaF: tFrac16
  f16BetaD: tFrac16
  f16BetaE: tFrac16
  f16BetaF: tFrac16

GMCLIB_CLARKINV_6PH_T_F32 = Simulink.Bus(DataScope="Imported", HeaderFile="GMCLIB_ClarkInv6Ph.h")
  f32AlphaD: tFrac32
  f32AlphaE: tFrac32
  f32AlphaF: tFrac32
  f32BetaD: tFrac32
  f32BetaE: tFrac32
  f32BetaF: tFrac32

GMCLIB_CLARKINV_6PH_T_FLT = Simulink.Bus(DataScope="Imported", HeaderFile="GMCLIB_ClarkInv6Ph.h")
  fltAlphaD: tFloat
  fltAlphaE: tFloat
  fltAlphaF: tFloat
  fltBetaD: tFloat
  fltBetaE: tFloat
  fltBetaF: tFloat

GMCLIB_DECOUPLINGPMSM_T_F16 = Simulink.Bus(DataScope="Imported", HeaderFile="GMCLIB_DecouplingPMSM.h")
  f16Kd: tFrac16
  s16KdShift: tS16
  f16Kq: tFrac16
  s16KqShift: tS16

GMCLIB_DECOUPLINGPMSM_T_F32 = Simulink.Bus(DataScope="Imported", HeaderFile="GMCLIB_DecouplingPMSM.h")
  f32Kd: tFrac32
  s16KdShift: tS16
  f32Kq: tFrac32
  s16KqShift: tS16

GMCLIB_DECOUPLINGPMSM_T_FLT = Simulink.Bus(DataScope="Imported", HeaderFile="GMCLIB_DecouplingPMSM.h")
  fltLD: tFloat
  fltLQ: tFloat

GMCLIB_DOUBLESWITCHING_3PH_EDGES_T_F16 = Simulink.Bus(DataScope="Imported", HeaderFile="GMCLIB_DoubleSwitching.h")
  pPhA: Bus: GMCLIB_DOUBLESWITCHING_EDGES_T_F16
  pPhB: Bus: GMCLIB_DOUBLESWITCHING_EDGES_T_F16
  pPhC: Bus: GMCLIB_DOUBLESWITCHING_EDGES_T_F16

GMCLIB_DOUBLESWITCHING_EDGES_T_F16 = Simulink.Bus(DataScope="Imported", HeaderFile="GMCLIB_DoubleSwitching.h")
  f16Edge1: tFrac16
  f16Edge2: tFrac16
  f16Edge3: tFrac16
  f16Edge4: tFrac16

GMCLIB_DOUBLESWITCHING_TRIGGERS_T_F16 = Simulink.Bus(DataScope="Imported", HeaderFile="GMCLIB_DoubleSwitching.h")
  u16Trigger1: tU16
  u16Trigger2: tU16
  u16Trigger3: tU16
  u16Trigger4: tU16

GMCLIB_DOUBLESWITCHING_T_F16 = Simulink.Bus(DataScope="Imported", HeaderFile="GMCLIB_DoubleSwitching.h")
  f16MinZeroPulse: tFrac16
  f16MinSamplingPulse: tFrac16
  f16SampleNhold: tFrac16

GMCLIB_SPREADPWM_T = Simulink.Bus(DataScope="Imported", HeaderFile="GMCLIB_SpreadPWM.h")
  u32Rnd: tU32
  u16ModMin: tU16
  u16ModMax: tU16
  u16CntK1: tU16
  f16Inc: tFrac16
  u16DevConst: tU16

GMCLIB_SVMSTD_6PH_T_F16 = Simulink.Bus(DataScope="Imported", HeaderFile="GMCLIB_SvmStd6Ph.h")
  f16AlphaD: tFrac16
  f16AlphaE: tFrac16
  f16AlphaF: tFrac16
  f16BetaD: tFrac16
  f16BetaE: tFrac16
  f16BetaF: tFrac16

GMCLIB_SVMSTD_6PH_T_F32 = Simulink.Bus(DataScope="Imported", HeaderFile="GMCLIB_SvmStd6Ph.h")
  f32AlphaD: tFrac32
  f32AlphaE: tFrac32
  f32AlphaF: tFrac32
  f32BetaD: tFrac32
  f32BetaE: tFrac32
  f32BetaF: tFrac32

GMCLIB_SVMSTD_6PH_T_FLT = Simulink.Bus(DataScope="Imported", HeaderFile="GMCLIB_SvmStd6Ph.h")
  fltAlphaD: tFloat
  fltAlphaE: tFloat
  fltAlphaF: tFloat
  fltBetaD: tFloat
  fltBetaE: tFloat
  fltBetaF: tFloat

AMCLIB_ESTIMRL_INIT_T_F32 = Simulink.Bus(DataScope="Imported", HeaderFile="AMCLIB_EstimRL.h")
  f32IDcMax: tFrac32
  u16LdqNumMeas: tU16
  f32IDcLd: tFrac32
  f32IDcLq: tFrac32
  f32IDcNegMax: tFrac32

AMCLIB_ESTIMRL_INNERST_T_F32 = Simulink.Bus(DataScope="Imported", HeaderFile="AMCLIB_EstimRL.h")
  pState: Enum: AMCLIB_ESTIMRL_STATE_T
  u16SamplingFreq: tU16
  f32FAc: tFrac32
  f32IDcMax: tFrac32
  f32IDcNegMax: tFrac32
  f32IAcReq: tFrac32
  u32IAcReqInv: tS32
  f32IDcDReq: tFrac32
  f32IDcDReqk_1: tFrac32
  f32IDcQReq: tFrac32
  f32IDcQReqk_1: tFrac32
  f32IDcReqStep: tFrac32
  f32IAlBeEstErr: tFrac32
  pIAlBeAc: Bus: SWLIBS_2Syst_F32
  pSinCosEst: Bus: SWLIBS_2Syst_F32
  pIDQAcRaw: Bus: SWLIBS_2Syst_F32
  pIDQAcFilt: Bus: SWLIBS_2Syst_F32
  pDAxisFilter: Bus: GDFLIB_FILTER_MA_T_F32
  pQAxisFilter: Bus: GDFLIB_FILTER_MA_T_F32
  pDcFilter: Bus: GDFLIB_FILTER_MA_T_F32
  pStdFilter: Bus: GDFLIB_FILTER_MA_T_F32
  f32PLLPropGain: tFrac32
  f32ThAc: tFrac32
  f32ThEst: tFrac32
  f32IDcD: tFrac32
  f32IDcQ: tFrac32
  s64IDcDAvg: tS64
  f32IDcDAvgk_1: tFrac32
  f32PhComp: tFrac32
  s32ConvDetState: tS32
  s32ConvDetStateLimL: tS32
  s32ConvDetStateLimH: tS32
  u32ConvDetToutCnt: tU32
  u32ConvDetToutReload: tU32
  u32AvgCnt: tU32
  u32AvgN: tU32
  u32AvgN1: tU32
  u32AvgCntMax: tU32
  f32PhAvg: tFrac32
  f32IAcAvg: tFrac32
  f32UAcAvg: tFrac32
  s32AvgMul: tS32
  s32AvgMin: tS32
  u16LdqNumMeas: tU16
  u32TblCounter: tU32
  u8RotorFixed: tU8
  f32IDcRampCoef: tFrac32
  f32IDcRampCoefMax: tFrac32
  f32IDcDRampAcc: tFrac32
  f32IDcQRampAcc: tFrac32
  f32UDcDAcc: tFrac32
  s64UDcDAccAvg: tS64
  f32UDcDAccAvgk_1: tFrac32
  f32UDcQAcc: tFrac32
  f32UAcAcc: tFrac32
  f32UDcKi: tFrac32
  f32UAcKi: tFrac32
  f32UDcKiNominal: tFrac32
  f32UAcKiNominal: tFrac32
  u16RampSteady: tU16
  u16DcbLimitFlag: tU16
  u16DcbLimitFlagk_1: tU16
  u16DcbLimitCnt: tU16
  f32PhaseShift: tFrac32
  f32UdcHalf: tFrac32
  f32FsInv: tFrac32
  f32ImpConst: tFrac32
  f32Ldk_1: tFrac32
  f32Lqk_1: tFrac32
  f32IDcLd: tFrac32
  f32IDcLq: tFrac32
  f32UdtAcc: tFrac32
  f32RAcc: tFrac32
  u16LdqNumMeasR: tU16
  f32UDcBusMax: tFrac32
  f32CDFineThr: tFrac32
  f32CDCoarseThr: tFrac32
  u16ScComp: tU16

AMCLIB_ESTIMRL_RUN_T_F32 = Simulink.Bus(DataScope="Imported", HeaderFile="AMCLIB_EstimRL.h")
  f32IDcDReq: tFrac32
  f32IDcQReq: tFrac32
  f32IAcReq: tFrac32
  u16FAc: tU16
  u8LdqSwitch: tU8

AMCLIB_ESTIMRL_T_F32 = Simulink.Bus(DataScope="Imported", HeaderFile="AMCLIB_EstimRL.h")
  f32Ld: tFrac32
  f32Lq: tFrac32
  f32R: tFrac32
  f32Udt: tFrac32
  pInnerState: Bus: AMCLIB_ESTIMRL_INNERST_T_F32